# Grasshopper definition notch geometry 2.gh (Grasshopper 1.0.4)

crv = Curve(<curve referenced from the Rhino model>)
input_shape = Curve(<curve referenced from the Rhino model>)
bbox = BoundingBox(Content=crv, Plane=PlaneXY(0, 0, 0))  # -> Box, Box_2
bbox_2 = BoundingBox(Content=input_shape, Plane=PlaneXY(0, 0, 0))  # -> Box, Box_2
explode = Explode(Curve=input_shape, Recursive=True)  # -> Segments, Vertices
debrep = DeconstructBrep(Brep=bbox.Box)  # -> Faces, Edges, Vertices
evalsrf = EvaluateSurface(Surface=reparameterize(debrep.Faces), Point="{0.0, 0.5, 0.0}")  # -> Point, Normal, UDirection, VDirection, Frame
item = ListItem(List=explode.Segments, Index=Slider(2, range=0..23), Wrap=True)
item_2 = ListItem(List=explode.Segments, Index=Slider(8, range=0..23), Wrap=True)
item_3 = ListItem(List=explode.Segments, Index=Slider(14, range=0..23), Wrap=True)
item_4 = ListItem(List=explode.Segments, Index=Slider(20, range=0..23), Wrap=True)
hframe = HorizontalFrame(Curve=reparameterize([item, item_2, item_3, item_4]), Parameter=Slider(0.5, range=0..1))
prot = RotatePlane(Plane=hframe, Angle=1.570796327)
orient = Orient(Geometry=crv, Source=evalsrf.Frame, Target=graft(prot))  # -> flatten(Geometry), Transform
rdiff = RegionDifference(CurvesA=input_shape, CurvesB=orient.Geometry)
orient_2 = Orient(Geometry=crv, Source=evalsrf.Frame, Target=graft(prot))  # -> flatten(Geometry), Transform
arrrec = RectangularArray(Geometry=rdiff, Cell=bbox_2.Box, XCount=Slider(15, range=0..100), YCount=Slider(15, range=0..100))  # -> Geometry, Transform
